# Grasshopper definition inflation [Mar-18 '21, 1710(1)].gh (Grasshopper 1.0.7)
# plug-ins: Kangaroo2 Components, MeshEdit Components

mesh = Mesh(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)
mesh_colours = MeshColours(Mesh=mesh, Colours=[RGB(216, 191, 216), RGB(255, 245, 238), RGB(211, 211, 211), RGB(175, 238, 238), RGB(255, 250, 205)])

# ---- group: RH_IN:iterations
number_slider = Slider(85, range=0..100)

# ----
livesoap = LiveSoap(
    Mesh=mesh,
    UseVolume=Toggle(True),
    VolumeChange=Slider(-1000, range=-1000..1000),
    Strength=Slider(10, range=0..10),
    Reset=number_slider)
zombiesolver = ZombieSolver(GoalObjects=livesoap, Threshold=1e-10, Tolerance=0.01, MaxIterations=number_slider)  # -> I, V, O
clean_tree = CleanTree(RemoveNulls=True, RemoveInvalid=True, RemoveEmpty=False, Tree=zombiesolver.O)
list_item = ListItem(List=clean_tree, Index=0, Wrap=True)
mesh_volume = MeshVolume(Mesh=list_item)  # -> Volume, Centroid
scale = Scale(Geometry=list_item, Center=mesh_volume.Centroid, Factor=Slider(1.453, range=0..10))  # -> Geometry, Transform
construct_plane = ConstructPlane(Origin=mesh_volume.Centroid, XAxis=Vector(1, 0, 0), YAxis=Vector(0, 1, 0))

# ---- group: RH_IN:scale_x
x = Slider(1.1, range=0..2)

# ---- group: RH_IN:scale_y
y = Slider(1.2, range=0..2)

# ---- group: RH_IN:scale_z
y_2 = Slider(1.2, range=0..2)

# ----
scale_nu = ScaleNU(Geometry=scale.Geometry, Plane=construct_plane, ScaleX=x, ScaleY=y, ScaleZ=y_2)  # -> Geometry, Transform
mesh_edges = MeshEdges(Mesh=scale_nu.Geometry)  # -> NakedEdges, InteriorEdges, NonManifoldEdges
flatten_tree = FlattenTree(Tree=mesh_edges.InteriorEdges, Path="{0}")
explode = Explode(Curve=flatten_tree, Recursive=True)  # -> Segments, Vertices
c_script = CSharpScript(crv=mesh_edges.InteriorEdges, color=ColourSwatch(SwatchColor=RGBA(135, 255, 241, 158)))  # -> out, A; inputs crv: Curve, color: Color
# ---------- c_script: C# ----------
    var c = color.R + "," + color.G + "," + color.B;
    crv.SetUserString("color", c);
    A = crv;
# ---------- end c_script ----------

# ---- group: RH_OUT:mesh
mesh_2 = Mesh(mesh_colours)

# ----
list_item_2 = ListItem(List=explode.Vertices, Index=0, Wrap=True)
trim_tree = TrimTree(Tree=list_item_2, Depth=1)
deconstruct = Deconstruct(Point=trim_tree)  # -> XComponent, YComponent, ZComponent
panel = Panel(deconstruct.ZComponent)
sort_list = SortList(Keys=deconstruct.ZComponent, ValuesA=flatten_tree)  # -> Keys, ValuesA
list_length = ListLength(List=sort_list.ValuesA)
range = Range(Domain="0 to 1", Steps=list_length)
gradient = Gradient(
    LowerLimit=0,
    UpperLimit=1,
    Parameter=range,
    stops=[0: RGB(134, 165, 237), 0: RGB(111, 173, 13), 0: RGB(243, 57, 0), 0: RGB(192, 202, 233), 0: RGB(30, 214, 196), 0.1: RGB(236, 27, 60), 0.227: RGB(210, 0, 118), 0.422: RGB(103, 0, 120), 0.6: RGB(39, 72, 161), 0.943: RGB(1, 192, 229)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])
c_script_2 = CSharpScript(crv=flatten_tree, color=gradient)  # -> out, A; inputs crv: Curve, color: Color; same code as c_script

# ---- group: RH_OUT:shell
curve = Curve(c_script_2.A)

# ----
custom_preview = CustomPreview(Geometry=flatten_tree, Material=gradient)
